# Grasshopper definition example_replayer.gh (Grasshopper 1.0.8)
# plug-ins: RhinoCodePluginGH

# ----
# Test File’s Path
panel = Panel("/Users/petingo/p/augmented-carpentry/")
path = Python3Script(ac_root_path=panel)  # -> out, log_root_path, ttool_download_path
# ---------- path: Python ----------
import os


log_root_path = os.path.join(ac_root_path, "assets/replayer_example/logs")
ttool_download_path = os.path.join(ac_root_path, "assets/replayer_example/TTool_dataset")
# ---------- end path ----------

panel_2 = Panel(path.ttool_download_path)
panel_3 = Panel(path.log_root_path)

acpy_replayer_initializer = AcpyReplayerInitializer(i_log_root_path=panel_3, i_exp_id="AC01", i_ttool_download_path=panel_2)  # -> o_replayer, o_frame_count; inputs i_log_root_path: String, i_exp_id: String, i_ttool_download_path: String, i_camera_model: GeometryBase
#   port i_log_root_path: The root path where the log files are stored.
#   port i_exp_id: The experiment id.
#   port i_ttool_download_path: The directory where the TTool models are downloaded.
#   port i_camera_model: Custom camera brep. If not provided, the default camera will be used. The camera brep should facing the positive z-axis.
#   port o_replayer: The initialized replayer object.
#   port o_frame_count: The total number of frames of the loaded log.
# ---------- acpy_replayer_initializer: Python ----------
"""Grasshopper Script Instance"""
import System
import Rhino

import os
import Rhino
import ghpythonlib

## FOR DEBUG
import sys
sys.path.append("/Users/petingo/p/augmented-carpentry/py/pypi")

from ACPy.replayer.replayer import Replayer

class ACPyReplayerInitializer(component):
    def __init__(self):
        super(ACPyReplayerInitializer, self).__init__()

    def RunScript(self,
            i_log_root_path: str,
            i_exp_id: str,
            i_ttool_download_path: str,
            i_camera_model: Rhino.Geometry.GeometryBase):
        replayer = Replayer()
        replayer.load(i_log_root_path, i_exp_id, i_ttool_download_path)

        if i_camera_model:
            replayer.set_camera_model(i_camera_model)

        return replayer, replayer.log_data.frame_count
    
# if __name__ == "__main__":
#     replayer, frame_count = ACPyReplayerInitializer().RunScript(log_root_path, exp_id, ttool_download_path, camera_model)
# ---------- end acpy_replayer_initializer ----------
panel_4 = Panel(acpy_replayer_initializer.o_frame_count)
acpy_replayer_scene_generator = AcpyReplayerSceneGenerator(i_replayer=acpy_replayer_initializer.o_replayer, i_frame_id=Slider(83807, range=0..86604))  # -> o_camera_model, o_tool_mesh, o_acim_bbox, o_acim_activated_component, o_acim_done_component, o_acim_not_done_component; inputs i_frame_id: Int32
#   port i_replayer: The initialized replayer object.
#   port i_frame_id: The target frame index.
#   port o_camera_model: Transformed camera brep.
#   port o_tool_mesh: Transformed tool mesh.
#   port o_acim_bbox: Transformed acim bounding box.
#   port o_acim_activated_component: Transformed acim activated component.
#   port o_acim_done_component: Transformed acim done component.
#   port o_acim_not_done_component: Transformed acim not done component.
# ---------- acpy_replayer_scene_generator: Python ----------
"""Grasshopper Script Instance"""
import System
import Rhino

import os
import Rhino
import ghpythonlib

class ACPyReplayerSceneGenerator(component):
    def __init__(self):
        super(ACPyReplayerSceneGenerator, self).__init__()

    def RunScript(self, i_replayer, i_frame_id: int):
        scene = i_replayer.generate_scene_at_frame(i_frame_id)

        camera_model = scene["camera_model"]
        tool_mesh = scene["tool_mesh"]
        acim_bbox = scene["acim_bbox"]
        acim_activated_component = scene["acim_activated_component"]
        acim_done_component = scene["acim_done_component"]
        acim_not_done_component = scene["acim_not_done_component"]

        return camera_model, tool_mesh, acim_bbox, acim_activated_component, acim_done_component, acim_not_done_component

# if __name__ == "__main__":
#     camera_model, tool_mesh, acim_bbox, acim_activated_component, acim_done_component, acim_not_done_component = \
#         ACPyReplayerSceneGenerator().RunScript(i_replayer, i_frame_id)
# ---------- end acpy_replayer_scene_generator ----------
debrep = DeconstructBrep(Brep=acpy_replayer_scene_generator.o_acim_bbox)  # -> Faces, Edges, Vertices

preview = CustomPreview(Geometry=acpy_replayer_scene_generator.o_camera_model, Material=ColourSwatch(SwatchColor=RGBA(0, 85, 204, 74)))
preview_2 = CustomPreview(Geometry=acpy_replayer_scene_generator.o_tool_mesh, Material=ColourSwatch(SwatchColor=RGB(98, 188, 196)))
preview_3 = CustomPreview(Geometry=debrep.Edges, Material=ColourSwatch(SwatchColor=RGBA(0, 0, 0, 165)))
preview_4 = CustomPreview(
    Geometry=acpy_replayer_scene_generator.o_acim_activated_component,
    Material=ColourSwatch(SwatchColor=RGBA(0, 128, 11, 74)))
preview_5 = CustomPreview(Geometry=acpy_replayer_scene_generator.o_acim_done_component, Material=ColourSwatch(SwatchColor=RGBA(41, 41, 41, 159)))
preview_6 = CustomPreview(
    Geometry=acpy_replayer_scene_generator.o_acim_not_done_component,
    Material=ColourSwatch(SwatchColor=RGBA(0, 40, 128, 74)))
